# Grasshopper definition SamplingData_001.gh (Grasshopper 1.0.7)
# plug-ins: Hops, Bifocals

samplingdata_001 = Hops(
    File="colors.txt",
    CacheResultsInMemory=False,
    CacheSolveResults=False,
    RemoteDefinitionLocation="http://127.0.0.1:5000/ReadText",
    RemoteSolveVersion=(0, 1, 0),
    ShowInput_Enabled=False,
    ShowInput_Path=False,
    SynchronousSolve=True)
panel = Panel(samplingdata_001)
text_split = TextSplit(Text=samplingdata_001, Separators="\")
dispatch = Dispatch(List=text_split, DispatchPattern=[True, False])  # -> ListA, ListB
panel_2 = Panel(text_split)
panel_3 = Panel(dispatch.ListB)
replace_text = ReplaceText(Text=dispatch.ListB, Find="t", RecursiveReplace=False)
panel_4 = Panel(dispatch.ListA)
panel_5 = Panel(replace_text)
cull_index = CullIndex(List=flatten(dispatch.ListA), Indices="0", Wrap=True)
cull_index_2 = CullIndex(List=flatten(replace_text), Indices="0", Wrap=True)
panel_6 = Panel(cull_index)
panel_7 = Panel(cull_index_2)
construct_point = ConstructPoint(XCoordinate=panel_7, YCoordinate=0, ZCoordinate=0)
circle = Circle(Plane=construct_point, Radius=1)
colours = Colours(graft(panel_6))
boundary_surfaces = BoundarySurfaces(Edges=circle)
mesh_sphere = MeshSphere(Base=construct_point, Radius=Slider(0.544, range=0..1), UCount=10, VCount=20)
mesh_brep = MeshBrep(
    Brep=boundary_surfaces,
    Settings={GridMaxCount=0, GridMinCount=16, JaggedSeams=False, MaxEdgeLength=0, MinEdgeLength=0.0001, MinTolerance=0, Refine=True, RefineAngle=0, RelativeTolerance=0.65, SimplePlanes=True, Tolerance=0})
mesh_colours = MeshColours(Mesh=graft(mesh_sphere), Colours=colours)
mesh_colours_2 = MeshColours(Mesh=graft(mesh_brep), Colours=colours)
